# Grasshopper definition lampshade_vertical_slicer.gh (Grasshopper 1.0.8)

amount_of_sides = Slider(5, range=0..10)
top_width = Slider(70, range=0..200)
base_width = Slider(76, range=0..200)
height = Slider(190, range=0..500)
center_width = Slider(86, range=0..200)
shape_spacing = Slider(25, range=0..200)

# ----
# setting up the base shape
vec = VectorXYZ(XComponent=0, YComponent=0, ZComponent=height)  # -> Vector, Length
polygon = Polygon(Plane=PlaneXY(0, 0, 0), Radius=top_width, Segments=amount_of_sides, FilletRadius=0)  # -> Polygon, Length
polygon_2 = Polygon(Plane=PlaneXY(0, 0, 0), Radius=center_width, Segments=amount_of_sides, FilletRadius=0)  # -> Polygon, Length
vec_2 = VectorXYZ(XComponent=0, YComponent=0, ZComponent=shape_spacing)  # -> Vector, Length
polygon_3 = Polygon(Plane=PlaneXY(0, 0, 0), Radius=base_width, Segments=amount_of_sides, FilletRadius=0)  # -> Polygon, Length
move = Move(Geometry=polygon.Polygon, Motion=vec.Vector)  # -> Geometry, Transform
move_2 = Move(Geometry=polygon_2.Polygon, Motion=vec_2.Vector)  # -> Geometry, Transform
loft = Loft(
    Curves=[move.Geometry, move_2.Geometry, polygon_3.Polygon],
    Options={Adjust=False, Closed=False, LoftEnds=0, LoftSimp=0, LoftType=0, Rebuild=10, Refit=0.01})

vec_3 = VectorXYZ(XComponent=0, YComponent=0, ZComponent=height)  # -> Vector, Length
vec_4 = VectorXYZ(XComponent=0, YComponent=0, ZComponent=0)  # -> Vector, Length
pt = Point(vec_4.Vector)
pt_2 = Point(vec_3.Vector)
ln = Line(StartPoint=pt_2, EndPoint=pt)
panel = Panel("twist")
twist = Twist(Geometry=loft, Axis=ln, Angle=Slider(0, range=0..2.5), Infinite=False, Rigid=False)

cap_holes = CapHoles(Brep=twist)
merge = Merge(Data1=cap_holes)

number_slider = Slider(0, range=0..100)
construct_point = ConstructPoint(XCoordinate=number_slider, YCoordinate=number_slider, ZCoordinate=number_slider)
unit_x = UnitX(Factor=1)
contour = Contour(Shape=merge, Point=construct_point, Direction=unit_x, Distance=Slider(16, range=0..100))
xy_plane = XYPlane(Origin=Point(0, 0, 0))
yz_plane = YZPlane(Origin=Point(0, 0, 0))
orient = Orient(Geometry=contour, Source=yz_plane, Target=xy_plane)  # -> Geometry, Transform
panel_2 = Panel("2d Slicing Algorithm")
geometry = Geometry(orient.Geometry)
bounding_box = BoundingBox(Content=flatten(geometry), Plane=PlaneXY(0, 0, 0))  # -> Box, Box_2
list_length = ListLength(List=bounding_box.Box)
box_properties = BoxProperties(Box=bounding_box.Box)  # -> Center, Diagonal, Area, Volume, Degeneracy
square_root = SquareRoot(Value=list_length)
deconstruct = Deconstruct(Point=box_properties.Diagonal)  # -> XComponent, YComponent, ZComponent
addition = Addition(A=square_root, B=Slider(-1, range=-2..1))
sort_list = SortList(Keys=[deconstruct.XComponent, deconstruct.YComponent])  # -> Keys, ValuesA
list_item = ListItem(List=sort_list.Keys, Index=Slider(-1, range=-10..5), Wrap=True)
rectangular = Rectangular(Plane=PlaneXY(0, 0, 0), SizeX=list_item, SizeY=list_item, ExtentX=square_root, ExtentY=addition)  # -> Cells, flatten(Points)
shortest_list = ShortestList(ListA=bounding_box.Box, ListB=rectangular.Points, TrimMode=2)  # -> ListA, ListB
addition_2 = Addition(B=shortest_list.ListB)
move_3 = Move(Geometry=flatten(geometry), Motion=addition_2)  # -> Geometry, Transform
project = Project(Geometry=move_3.Geometry, Plane=PlaneXY(0, 0, 0))  # -> Geometry, Transform
geometry_2 = Geometry(project.Geometry)
area = Area(Geometry=geometry_2)  # -> Area, Centroid
series = Series(Start=Slider(1, range=0..1), Step=1, Count=list_length)
text_tag_3d = TextTag3D(Location=area.Centroid, Text=series, Size=Slider(10, range=0..10), Justification=7)
